# Grasshopper definition SpiralPhyllotaxicSurface.gh (Grasshopper 0.9.76)
# plug-ins: phyllopoint

pt = Point([<point referenced from the Rhino model> x7])
phyllopoint = Phyllopoint(Pts=pt, Num=Slider(881, range=0..1000))  # -> Pts, R, ExprResult, Link
multiplication = Multiplication(A=phyllopoint.R, B=Slider(1, range=0..10))
sph = Sphere(Base=phyllopoint.Pts, Radius=multiplication)
